# Grasshopper definition hypertable.gh (Grasshopper 1.0.7)

table_top_width = Slider(120.5, range=10..200)
table_top_depth = Slider(60.3, range=10..200)
table_top_thickness = Slider(2, range=0..10)
second_table_top_height = Slider(15.2, range=0..100)
foot_width = Slider(5, range=2..10)
foot_depth = Slider(7, range=2..10)
foot_height = Slider(34.9, range=10..100)
reserve = Slider(3.5, range=0..20)
neg = Negative(Value=foot_height)
subtraction = Subtraction(A=0, B=neg)
neg_2 = Negative(Value=second_table_top_height)
xy = XYPlane(Origin=Point(0, 0, 0))
multiplication = Multiplication(A=foot_depth, B=2)
subtraction_2 = Subtraction(A=foot_depth, B=reserve)
pl_offset = PlaneOffset(BasePlane=xy, Offset=subtraction)
addition = Addition(A=subtraction, B=neg_2)
multiplication_2 = Multiplication(A=reserve, B=2)
subtraction_3 = Subtraction(A=table_top_depth, B=multiplication)
pl_offset_2 = PlaneOffset(BasePlane=xy, Offset=addition)
addition_2 = Addition(A=subtraction_3, B=multiplication_2)
rectangle = Rectangle(Plane=pl_offset, XSize=table_top_width, YSize=table_top_depth, Radius=0)  # -> Rectangle, Length
vec = VectorXYZ(XComponent=0, YComponent=subtraction_2, ZComponent=0)  # -> Vector, Length
rectangle_2 = Rectangle(Plane=pl_offset_2, XSize=table_top_width, YSize=addition_2, Radius=0)  # -> Rectangle, Length
move = Move(Geometry=rectangle_2.Rectangle, Motion=vec.Vector)  # -> Geometry, Transform
drec = DeconstuctRectangle(Rectangle=rectangle.Rectangle)  # -> BasePlane, XInterval, YInterval
boxrec = BoxRectangle(Rectangle=rectangle.Rectangle, Height=table_top_thickness)
box_corners = BoxCorners(Box=boxrec)  # -> CornerA, CornerB, CornerC, CornerD, CornerE, CornerF, CornerG, CornerH
ln = Line(StartPoint=box_corners.CornerA, EndPoint=box_corners.CornerE)
ln_2 = Line(StartPoint=box_corners.CornerA, EndPoint=box_corners.CornerB)
ln_3 = Line(StartPoint=box_corners.CornerA, EndPoint=box_corners.CornerB)
ln_4 = Line(StartPoint=box_corners.CornerA, EndPoint=box_corners.CornerD)
lineardim = LinearDimension(Line=ln, PointA=box_corners.CornerA, PointB=box_corners.CornerE, Text="{0:0.00}", Size=1)
lineardim_2 = LinearDimension(Line=ln_2, PointA=box_corners.CornerA, PointB=box_corners.CornerB, Text="{0:0.00}", Size=1)
lineardim_3 = LinearDimension(Line=ln_3, PointA=box_corners.CornerA, PointB=box_corners.CornerB, Text="{0:0.00}", Size=1)
lineardim_4 = LinearDimension(Line=ln_4, PointA=box_corners.CornerA, PointB=box_corners.CornerD, Text="{0:0.00}", Size=1)
subtraction_4 = Subtraction(A=table_top_depth, B=foot_depth)
boxrec_2 = BoxRectangle(Rectangle=move.Geometry, Height=table_top_thickness)
multiplication_3 = Multiplication(A=foot_depth, B=2)
rectangle_3 = Rectangle(Plane=drec.BasePlane, XSize=foot_width, YSize=foot_depth, Radius=0)  # -> Rectangle, Length
subtraction_5 = Subtraction(A=table_top_width, B=foot_width)
subtraction_6 = Subtraction(A=table_top_depth, B=multiplication_3)
vec_2 = VectorXYZ(XComponent=subtraction_5, YComponent=subtraction_4, ZComponent=0)  # -> Vector, Length
vec_3 = VectorXYZ(XComponent=0, YComponent=subtraction_4, ZComponent=0)  # -> Vector, Length
vec_4 = VectorXYZ(XComponent=subtraction_5, YComponent=0, ZComponent=0)  # -> Vector, Length
subtraction_7 = Subtraction(A=neg, B=foot_depth)
subtraction_8 = Subtraction(A=table_top_width, B=foot_width)
boxrec_3 = BoxRectangle(Rectangle=rectangle_3.Rectangle, Height=neg)
rectangle_4 = Rectangle(Plane=drec.BasePlane, XSize=foot_width, YSize=subtraction_6, Radius=0)  # -> Rectangle, Length
move_2 = Move(Geometry=boxrec_3, Motion=vec_3.Vector)  # -> Geometry, Transform
move_3 = Move(Geometry=boxrec_3, Motion=vec_4.Vector)  # -> Geometry, Transform
move_4 = Move(Geometry=boxrec_3, Motion=vec_2.Vector)  # -> Geometry, Transform
vec_5 = VectorXYZ(XComponent=0, YComponent=foot_depth, ZComponent=neg)  # -> Vector, Length
vec_6 = VectorXYZ(XComponent=subtraction_8, YComponent=0, ZComponent=0)  # -> Vector, Length
move_5 = Move(Geometry=rectangle_4.Rectangle, Motion=vec_5.Vector)  # -> Geometry, Transform
sdiff = SolidDifference(BrepsA=move_4.Geometry, BrepsB=boxrec_2)
sdiff_2 = SolidDifference(BrepsA=boxrec_3, BrepsB=boxrec_2)
sdiff_3 = SolidDifference(BrepsA=move_2.Geometry, BrepsB=boxrec_2)
sdiff_4 = SolidDifference(BrepsA=move_3.Geometry, BrepsB=boxrec_2)
boxrec_4 = BoxRectangle(Rectangle=move_5.Geometry, Height=foot_depth)
move_6 = Move(Geometry=boxrec_4, Motion=vec_6.Vector)  # -> Geometry, Transform
